# Grasshopper definition 02C-Wide Flowlines B.gh (Grasshopper 0.9.76)
# plug-ins: Python Interpreter

panel = Panel("""Linework_InterventionOutlines
Linework_Drainage_Lines_Site""")
# NEED TO ADD SCALE TO FLOWLINE WIDTH
number_slider = Slider(224, range=1..1374)
panel_2 = Panel("F:\Local Code\Work\Local Code - San Francisco\06 DB\Pickles\")
mindex = MemberIndex(Set=panel, Member="Linework_Drainage_Lines_Site")  # -> Index, Count
mindex_2 = MemberIndex(Set=panel, Member="Linework_InterventionOutlines")  # -> Index, Count
path = ConstructPath(Indices=mindex.Index)
unpickle_geometry = UnPickleGeometry(siteNumber=number_slider, layer="Data_CNN", path=panel_2, read=panel_2)  # -> out, geometry
# ---------- unpickle_geometry: Python ----------
import cPickle as pickle

if path and read and layer:
    try:
        if siteNumber:
            f = open(path+str(int(siteNumber))+layer)
        else:
            f = open(path+layer)
        geometry = pickle.load(f)
        f.close()

    except:
        print 'problem loading %s\nfile may not exist' % path+str(int(siteNumber))+layer
# ---------- end unpickle_geometry ----------
path_2 = ConstructPath(Indices=mindex_2.Index)
unpickle_geometry_2 = UnPickleGeometry(siteNumber=number_slider, layer=panel, path=panel_2, read=Toggle(True))  # -> out, simplify(geometry); same code as unpickle_geometry
geo = Geometry(unpickle_geometry_2.geometry)
geo_2 = Geometry(unpickle_geometry_2.geometry)
branch = TreeBranch(Tree=geo, Path=path, MaintainPaths=True)
branch_2 = TreeBranch(Tree=geo_2, Path=path_2, MaintainPaths=True)

# ---- group: flowlines-curves
geo_3 = Geometry(branch)

# ----
panel_3 = Panel(unpickle_geometry_2.geometry)
viewer = ParamViewer(unpickle_geometry_2.geometry)

# ---- group: flowlines-curves
geo_4 = Geometry(geo_3)

# ----
len = Length(Curve=geo_4)
sort = SortList(Keys=len, ValuesA=geo_4)  # -> Keys, ValuesA

# ---- group: sorted flowline curves
geo_5 = Geometry(sort.ValuesA)

# ----
wideyness = Slider(1.2, range=0..10)

# ---- group: intervention outline
geo_6 = Geometry(branch_2)

# ----
end = EndPoints(Curve=geo_5)  # -> Start, End
item = ListItem(List=reverse(flatten(sort.Keys)), Index=0, Wrap=True)

# ---- group: line starts
geo_7 = Geometry(end.Start)

# ----
crv_cp = CurveClosestPoint(Point=graft(geo_7), Curve=geo_6)  # -> Point, Parameter, Distance

# ---- group: curves
lng = ListLength(List=flatten(geo_7))
repeat = RepeatData(Data=graft(geo_6), Length=lng)
flip = FlipMatrix(Data=simplify(repeat))
sort_2 = SortList(Keys=crv_cp.Distance, ValuesA=flip)  # -> Keys, ValuesA
item_2 = ListItem(List=sort_2.ValuesA, Index=0, Wrap=True)

# ----
remap = RemapNumbers(Value=sort.Keys, Source=item, Target=wideyness)  # -> simplify(graft(Mapped)), Clipped

# ---- group: parameters
sort_3 = SortList(Keys=crv_cp.Distance, ValuesA=crv_cp.Parameter)  # -> Keys, ValuesA
item_3 = ListItem(List=sort_3.ValuesA, Index=0, Wrap=True)

# ---- group: points
sort_4 = SortList(Keys=crv_cp.Distance, ValuesA=crv_cp.Point)  # -> Keys, ValuesA
item_4 = ListItem(List=sort_4.ValuesA, Index=0, Wrap=True)

# ----
addition = Addition(A=simplify(item_3), B=simplify(remap.Mapped))
subtraction = Subtraction(A=graft(item_3), B=simplify(remap.Mapped))
dom = ConstructDomain(DomainStart=subtraction, DomainEnd=addition)
eval = EvaluateCurve(Curve=simplify(item_2), Parameter=simplify(addition))  # -> Point, Tangent, Angle
eval_2 = EvaluateCurve(Curve=simplify(item_2), Parameter=simplify(subtraction))  # -> Point, Tangent, Angle

# ---- group: sorted flowline curves
geo_8 = Geometry(geo_5)

# ----
vec2pt = Vector2Pt(PointA=graft(geo_7), PointB=eval.Point, Unitize=False)  # -> Vector, Length
vec2pt_2 = Vector2Pt(PointA=graft(geo_7), PointB=eval_2.Point, Unitize=False)  # -> Vector, Length
cp = ControlPoints(Curve=geo_8)  # -> Points, Weights, Knots
lng_2 = ListLength(List=cp.Points)
range = Range(Domain=Domain(0, 1), Steps=lng_2)
multiplication = Multiplication(A=vec2pt.Vector, B=range)  # -> reverse(simplify(Result))
multiplication_2 = Multiplication(A=vec2pt_2.Vector, B=range)  # -> reverse(simplify(Result))
pt = Point(cp.Points)
move = Move(Geometry=simplify(pt), Motion=multiplication)  # -> Geometry, Transform
move_2 = Move(Geometry=simplify(pt), Motion=multiplication_2)  # -> Geometry, Transform
subcrv = SubCurve(BaseCurve=simplify(item_2), Domain=simplify(dom))
intcrv = Interpolate(Vertices=move_2.Geometry, Degree=3, Periodic=False, KnotStyle=1)  # -> Curve, Length, Domain
intcrv_2 = Interpolate(Vertices=move.Geometry, Degree=3, Periodic=False, KnotStyle=1)  # -> Curve, Length, Domain
merge = Merge(Data1=intcrv_2.Curve, Data2=intcrv.Curve, Data3=subcrv)

# ---- group: extruded traces
join = JoinCurves(Curves=merge, Preserve=False)

# ---- group: drainage lines from outline
geo_9 = Geometry(join)

# ----
pickler = Pickler(
    data=flatten(geo_9),
    siteNumber=number_slider,
    layer="Linework_Wide_Drainage_Lines_Site",
    path=panel_2,
    write=Toggle(True))  # -> out, geometry; inputs data: list of GeometryBase
# ---------- pickler: Python ----------
import cPickle as pickle

if path and data and write:
    if siteNumber:
        f = open(path+str(int(siteNumber))+layer, 'wb')
    else:
        f = open(path+layer, 'wb')
    pickle.dump(data, f)
    f.close()
    fcheck = open(path+str(int(siteNumber))+layer)
    geometry = pickle.load(fcheck)
    fcheck.close()
# ---------- end pickler ----------
